# Dynamo graph priority wall script.dyn (Dynamo 2.1.0.7500)

element_types = ElementTypes("Wall")
all_elements_of_type = ElementsOfType(element_type=element_types)
watch = Watch(all_elements_of_type)
element_types_2 = ElementTypes("Wall")
all_elements_of_type_2 = ElementsOfType(element_type=element_types_2)
name = Element.Name(element=all_elements_of_type_2)
byName = WallType.ByName(name=name)
uniqueItems = List.UniqueItems(list=byName)
name_2 = Element.Name(element=uniqueItems)
code_block = CodeBlock { "HR"; }
boolean = BoolSelector(true)
contains = String.Contains(str=name_2, searchFor=code_block, ignoreCase=boolean)
filterByBoolMask = List.FilterByBoolMask(list=uniqueItems, mask=contains)

# group: Excel Import
file_path = Filename("..\..\..\..\..\..\..\Documents\wall types")
string = StringInput("Sheet 1")
number = DoubleInput(0)
boolean_2 = BoolSelector(true)
exportExcel = Data.ExportExcel(filePath=file_path, sheetName=string, startRow=number, startCol=number, data=filterByBoolMask.in, overWrite=boolean_2)

watch_2 = Watch(filterByBoolMask.in)
